# Dynamo graph CelosiaMuro.dyn (Dynamo 2.13.1.3887)

# group: Primera linea
code_block = CodeBlock { 1; 2.5; }
byCoordinates = Point.ByCoordinates(x=code_block.out0, y=code_block.out1)
number_slider = DoubleSlider(3.9, range=0.1..5 step 0.1)
translate = Geometry.Translate(geometry=byCoordinates, yTranslation=number_slider)
byStartPointEndPoint = Line.ByStartPointEndPoint(startPoint=byCoordinates, endPoint=translate)

# group: Duplicado de linea paralela
normalAtParameter = Curve.NormalAtParameter(curve=byStartPointEndPoint)
number_slider_2 = DoubleSlider(0.34, range=0.3..0.6 step 0.01)
scale = Vector.Scale(vector=normalAtParameter, scale_factor=number_slider_2)
translate_2 = Geometry.Translate(geometry=byStartPointEndPoint, direction=normalAtParameter)

code_block_2 = CodeBlock { 0..1..#10; }
pointAtParameter = Curve.PointAtParameter(curve=translate_2, param=code_block_2)
indexOf = List.IndexOf(list=pointAtParameter, element=pointAtParameter)
pointAtParameter_2 = Curve.PointAtParameter(curve=byStartPointEndPoint, param=code_block_2)
indexOf_2 = List.IndexOf(list=pointAtParameter_2, element=pointAtParameter_2)
code_block_3 = CodeBlock { 0; 2; }
mod = indexOf_2 % code_block_3.out1
eq = mod == code_block_3.out0
filterByBoolMask = List.FilterByBoolMask(list=indexOf_2, mask=eq)
list_create = List.Create(item0=filterByBoolMask.out)
list_create_2 = List.Create(item0=filterByBoolMask.in)
code_block_4 = CodeBlock { -1; }
shiftIndices = List.ShiftIndices(list=list_create_2, amount=code_block_4)
