# Dynamo graph CelosiaMuro01.dyn "CelosiaMuro" (Dynamo 2.13.1.3887)

categories = Categories("OST_Walls")
all_elements_of_category = ElementsOfCategory(Category=categories)
getLocation = Element.GetLocation(element=all_elements_of_category)
watch = Watch(getLocation)
code_block = CodeBlock(l=getLocation) { l[0].StartPoint; }
code_block_2 = CodeBlock { 1; 2; }
byCoordinates = Vector.ByCoordinates(x=code_block_2.out0, y=code_block_2.out1)
code_block_3 = CodeBlock { 5; }
byStartPointDirectionLength = Line.ByStartPointDirectionLength(startPoint=code_block, direction=byCoordinates, length=code_block_3)
code_block_4 = CodeBlock { 0.05; }
extrude = Curve.Extrude(curve=byStartPointDirectionLength, distance=code_block_4)
normalAtParameter = Curve.NormalAtParameter(curve=byStartPointDirectionLength)
code_block_5 = CodeBlock { 0.3; }
scale = Vector.Scale(vector=normalAtParameter, scale_factor=code_block_5)
translate = Geometry.Translate(geometry=byStartPointDirectionLength, direction=scale)
code_block_6 = CodeBlock { 0..1..0.1; }
pointAtParameter = Curve.PointAtParameter(curve=translate, param=code_block_6)
indexOf = List.IndexOf(list=pointAtParameter, element=pointAtParameter)
code_block_7 = CodeBlock { 2; }
mod = indexOf % code_block_7
code_block_8 = CodeBlock { 0; }
eq = Equals(x=mod, y=code_block_8)
filterByBoolMask = List.FilterByBoolMask(list=pointAtParameter, mask=eq)
pointAtParameter_2 = Curve.PointAtParameter(curve=byStartPointDirectionLength, param=code_block_6)
indexOf_2 = List.IndexOf(list=pointAtParameter_2, element=pointAtParameter_2)
mod_2 = indexOf_2 % code_block_7
eq_2 = Equals(x=mod_2, y=code_block_8)
filterByBoolMask_2 = List.FilterByBoolMask(list=pointAtParameter_2, mask=eq_2)
byStartPointEndPoint = Line.ByStartPointEndPoint(startPoint=filterByBoolMask.in, endPoint=filterByBoolMask_2.out)
extrude_2 = Curve.Extrude(curve=byStartPointEndPoint, distance=code_block_4)
extrude_3 = Curve.Extrude(curve=translate, distance=code_block_4)
code_block_9 = CodeBlock { -1; }
shiftIndices = List.ShiftIndices(list=filterByBoolMask.in, amount=code_block_9)
byStartPointEndPoint_2 = Line.ByStartPointEndPoint(startPoint=shiftIndices, endPoint=filterByBoolMask_2.out)
extrude_4 = Curve.Extrude(curve=byStartPointEndPoint_2, distance=code_block_4)
list_create = List.Create(item0=extrude, item1=extrude_2, item2=extrude_3, item3=extrude_4)
code_block_10 = CodeBlock { 2.5; }
thicken = Surface.Thicken(surface=list_create, thickness=code_block_10)
byPoints = NurbsCurve.ByPoints()  # unwired: points
startPoint = Curve.StartPoint(curve=byStartPointDirectionLength)
startPoint_2 = Curve.StartPoint(curve=translate)
list_create_2 = List.Create(item0=startPoint, item1=startPoint_2)
byPoints_2 = PolyCurve.ByPoints(points=list_create_2)
code_block_11 = CodeBlock { -2.5..2.5; }
extrude_5 = Curve.Extrude(curve=byPoints_2, distance=code_block_11)
code_block_12 = CodeBlock { 0.05; }
thicken_2 = Surface.Thicken(surface=extrude_5, thickness=code_block_12)
endPoint = Curve.EndPoint(curve=byStartPointDirectionLength)
endPoint_2 = Curve.EndPoint(curve=translate)
list_create_3 = List.Create(item0=endPoint, item1=endPoint_2)
byPoints_3 = PolyCurve.ByPoints(points=list_create_3)
extrude_6 = Curve.Extrude(curve=byPoints_3, distance=code_block_11)
thicken_3 = Surface.Thicken(surface=extrude_6, thickness=code_block_12)
