# Dynamo graph CelosiaMuro02.dyn (Dynamo 2.13.1.3887)

# group: Primera linea
code_block = CodeBlock { 1; 2.5; }
byCoordinates = Point.ByCoordinates(x=code_block.out0, y=code_block.out1)
number_slider = DoubleSlider(3.9, range=0.1..5 step 0.1)
translate = Geometry.Translate(geometry=byCoordinates, yTranslation=number_slider)
byStartPointEndPoint = Line.ByStartPointEndPoint(startPoint=byCoordinates, endPoint=translate)

# group: Duplicado de linea paralela
normalAtParameter = Curve.NormalAtParameter(curve=byStartPointEndPoint)
number_slider_2 = DoubleSlider(0.34, range=0.3..0.6 step 0.01)
scale = Vector.Scale(vector=normalAtParameter, scale_factor=number_slider_2)
translate_2 = Geometry.Translate(geometry=byStartPointEndPoint, direction=normalAtParameter)

code_block_2 = CodeBlock { 0..1..#10; }
pointAtParameter = Curve.PointAtParameter(curve=translate_2, param=code_block_2)
indexOf = List.IndexOf(list=pointAtParameter, element=pointAtParameter)
pointAtParameter_2 = Curve.PointAtParameter(curve=byStartPointEndPoint, param=code_block_2)
indexOf_2 = List.IndexOf(list=pointAtParameter_2, element=pointAtParameter_2)
code_block_3 = CodeBlock { 0; 2; }
mod = indexOf_2 % code_block_3.out1
eq = mod == code_block_3.out0
filterByBoolMask = List.FilterByBoolMask(list=indexOf_2, mask=eq)
list_create = List.Create(item0=filterByBoolMask.out)
list_create_2 = List.Create(item0=filterByBoolMask.in)
code_block_4 = CodeBlock { -1; }
shiftIndices = List.ShiftIndices(list=list_create_2, amount=code_block_4)
categories = Categories("OST_Walls")
all_elements_of_category = ElementsOfCategory(Category=categories)
geometry = Element.Geometry(element=all_elements_of_category)
explode = Geometry.Explode(geometry=geometry)
flatten = List.Flatten(list=explode)
area = Surface.Area(surface=flatten)
sortByKey = List.SortByKey(list=flatten, keys=area)
number_slider_3 = DoubleSlider(-2, range=-6..6 step 1)
takeItems = List.TakeItems(list=sortByKey.sortedList, amount=number_slider_3)
perimeterCurves = Surface.PerimeterCurves(surface=takeItems)
flatten_2 = List.Flatten(list=perimeterCurves)
direction = Line.Direction(line=flatten_2)
ZAxis = Vector.ZAxis()
cross = Vector.Cross(vector=direction, cross=ZAxis)
length = Vector.Length(vector=cross)
sortByKey_2 = List.SortByKey(list=flatten_2, keys=length)
code_block_5 = CodeBlock { 4; }
takeItems_2 = List.TakeItems(list=sortByKey_2.sortedList, amount=code_block_5)
getLocation = Element.GetLocation(element=takeItems_2)
