# Dynamo graph ExportarTabla.dyn (Dynamo 2.18.1.5096)
# packages: bimorphNodes 4.2.4

file_path = Filename("..\Modelos\Documentos Modelo\ParametrosModelo-CasaRural_Feb.CSV")

# group: Obtener parametro, Revit.ElementID
# Se obtiene de los elementos activos en la vista de tabla de planificación
code_block = CodeBlock { L=["Revit.ElementId"]; [""]; }
all_elements_in_active_view = ElementsInView()
uniqueId = Element.UniqueId(element=all_elements_in_active_view)
addItemToFront = List.AddItemToFront(item=code_block.out1, list=uniqueId)
aplanar_lista = CodeBlock(a=addItemToFront) { List.Flatten(a,1); }

# group: Obtiene tabla en forma de lista
views = Views("Multi-Category Schedule")

getData = Revit.Schedule.GetData(scheduleView=views)

# group (continued): Obtiene tabla en forma de lista
transpose = List.Transpose(lists=getData)

addItemToFront_2 = List.AddItemToFront(item=aplanar_lista, list=transpose)
transpose_2 = List.Transpose(lists=addItemToFront_2)
exportCSV = Data.ExportCSV(filePath=file_path, data=transpose_2)
