# Dynamo graph Parametros.dyn (Dynamo 2.18.1.5096)

file_path = Filename("..\Parametros_Proyecto.xlsx")
file_from_path = FileObject(path=file_path)
code_block = CodeBlock { "Sheet_1"; true; false; }
importExcel = Data.ImportExcel(file=file_from_path, sheetName=code_block.out0, readAsStrings=code_block.out1, showExcel=code_block.out2)
code_block_2 = CodeBlock(x=importExcel) { y=List.RemoveItemAtIndex(x,0); z=List.Transpose(y); z[0]; z[5]; z[2]; }
code_block_3 = CodeBlock { ""; true; }
spec_types = SpecTypes("autodesk.spec:spec.string")
group_types = GroupTypes("autodesk.parameter.group:text")
categories = Categories("OST_Roofs")
categories_2 = Categories("OST_Gutter")
code_block_4 = CodeBlock(s=categories, f=categories_2) { b = [s,f]; List.Flatten(b,1); }
arreglo_de_categorias = CodeBlock(a=code_block_2.out3, CatRoofs=code_block_4.b)
# ---------- arreglo_de_categorias.designscript (13 lines) ----------
b=List.Count(a)-1;
CatRoofs;
[Imperative]//Aplica
{	p = [];
	l = 0..b;
	for(i in l)
	{
		k = List.AddItemToEnd(CatRoofs, Category.ByName(List.Flatten(String.Split(a[i],", "),1)));
		p[i] = List.Flatten(k,1);
	}
	return p;

};
# ----------------------------------------
createProjectParameter = Parameter.CreateProjectParameter(parameterName=code_block_2.out2, groupName=code_block_3.out0, specType=spec_types, groupType=group_types, instance=code_block_3.out1, categoryList=arreglo_de_categorias.out2)
