# Dynamo graph Parametros2024.dyn (Dynamo 2.17.0.3472)

all_elements_in_active_view = ElementsInView()
elementType = Element.ElementType(element=all_elements_in_active_view)
getCategory = Element.GetCategory(element=elementType)
parameters = Element.Parameters(element=elementType)
uniqueId = Element.UniqueId(element=elementType)
