# Dynamo graph Parametros_Instancia.dyn (Dynamo 2.17.0.3472)

file_path = Filename("..\ProjectParameter.xlsx")
file_from_path = FileObject(path=file_path)
code_block = CodeBlock { "Sheet_1"; true; false; }
importExcel = Data.ImportExcel(file=file_from_path, sheetName=code_block.out0, readAsStrings=code_block.out1, showExcel=code_block.out2)  # frozen
code_block_2 = CodeBlock(x=importExcel) { y=List.RemoveItemAtIndex(x,0); z=List.Transpose(y); z[0]; z[5]; z[2]; }
code_block_3 = CodeBlock { ""; true; }
spec_types = SpecTypes("autodesk.spec:spec.string")
group_types = GroupTypes("autodesk.parameter.group:text")
byName = Category.ByName(name=code_block_2.out3)
createProjectParameter = Parameter.CreateProjectParameter(parameterName=code_block_2.out2, groupName=code_block_3.out0, specType=spec_types, groupType=group_types, instance=code_block_3.out1, categoryList=byName)  # frozen
watch = Watch(code_block_2.out2)
createProjectParameterForAllCategories = Parameter.CreateProjectParameterForAllCategories()  # unwired: parameterName, groupName, specType, groupType, instance
all_elements_in_active_view = ElementsInView()
parameters = Element.Parameters(element=all_elements_in_active_view)
code_block_4 = CodeBlock { Parametros = ["Category", "Name", "Family", "Mark", "Comments"]; }
python_script = Python(IN[0]=parameters, IN[1]=code_block_4)  # CPython3
# ---------- python_script.python (32 lines) ----------
# Load the Python Standard and DesignScript Libraries
import sys
import clr
clr.AddReference('ProtoGeometry')
from Autodesk.DesignScript.Geometry import *

# The inputs to this node will be stored as a list in the IN variables.
dataEnteringNode = IN

# Place your code below this line
a = IN[0]
title = []
parametros = []
fila = []
matriz =[]

#OBTENIENDO TITULOS
for i in a[0]:
    title.append(str(i).split(":")[0])
#AGREGAR TITULO A MATRIZ
matriz.append(title)
#OBTENIENDO PARAMETROS DE ELEMENTOS

for j in a:
    parametros.clear()
    for k in j:
        parametros.append(str(k).split(":")[1])
#AGREANDO CADA FILA DE LOS PARAMETROS
    matriz.append(parametros)

# Assign your output to the OUT variable.
OUT = matriz
# ----------------------------------------
watch_2 = Watch(python_script)
watch_3 = Watch(parameters)
watch_4 = Watch(code_block_4)
