# Dynamo graph RutinaMuros.dyn (Dynamo 2.13.1.3887)

element_classes = ElementTypes("Wall")
all_elements_of_class = ElementsOfType(element_class=element_classes)
geometry = Element.Geometry(element=all_elements_of_class)
explode = Geometry.Explode(geometry=geometry)
getItemAtIndex = List.GetItemAtIndex(list=explode)  # unwired: index
flatten = List.Flatten(list=getItemAtIndex)
area = Surface.Area(surface=getItemAtIndex)
flatten_2 = List.Flatten(list=area)
sortByKey = List.SortByKey(list=flatten, keys=flatten_2)
reverse = List.Reverse(list=sortByKey.sortedList)
code_block = CodeBlock { 2; }
chop = List.Chop(list=reverse, lengths=code_block)
code_block_2 = CodeBlock { 0; }
getItemAtIndex_2 = List.GetItemAtIndex(list=chop, index=code_block_2)
list_create = List.Create(item0=getItemAtIndex_2)
flatten_3 = List.Flatten(list=list_create)
code_block_3 = CodeBlock { 4/100; }
thicken = Surface.Thicken(thickness=code_block_3)  # unwired: surface
numero_indices = CodeBlock(list=explode) { List.Count(list)-1; }
code_block_4 = CodeBlock()  # unwired: MaxInd
# ---------- code_block_4.designscript (8 lines) ----------
i=0;
MaxInd;
list=[]

while (i < MaxInd)
{
i;
};
# ----------------------------------------
code_block_5 = CodeBlock()
# ---------- code_block_5.designscript (10 lines) ----------
sum = 0;
x = 0;
[Imperative]

while (x < 10)
{
sum = sum + x;
x = x + 1;
}
// sum == 55
# ----------------------------------------
