# Dynamo graph UniqueId.dyn (Dynamo 2.16.1.2727)

id = Parameter.Id()  # unwired: parameter
categories = Categories("OST_Walls")
all_elements_of_category = ElementsOfCategory(Category=categories)
code_block = CodeBlock { "UniqueId"; }
getParameterValueByName = Element.GetParameterValueByName(element=all_elements_of_category, parameterName=code_block)
uniqueId = Element.UniqueId(element=all_elements_of_category)
watch = Watch(uniqueId)
